# Dynamo graph ЦК_М3_Python и Визуальное программирование_Тема-2_Лекция 2.2.dyn (Dynamo 2.13.1.3887)

# group: Получение всех вхождений блоков чертежа
objects_types = AcObjectTypes("Вхождение блока")
current = Autodesk.AutoCAD.DynamoNodes.Document.Current()
modelSpace = Autodesk.AutoCAD.DynamoNodes.Document.ModelSpace(document=current)
all_objects_of_type = AcObjectsOfType(type=objects_types, block=modelSpace)

# group: Уточнение набора блоков и выборка только нужных по его имени
block = Autodesk.AutoCAD.DynamoNodes.BlockReference.Block(blockReference=all_objects_of_type)
name = Autodesk.AutoCAD.DynamoNodes.Block.Name(block=block)
code_block = CodeBlock { "g5_388_1"; }
eq = name == code_block
filterByBoolMask = List.FilterByBoolMask(list=all_objects_of_type, mask=eq)

# group: Создание в точке вставке блока Конуса
coordinateSystem = Autodesk.AutoCAD.DynamoNodes.BlockReference.CoordinateSystem(blockReference=filterByBoolMask.in)
code_block_2 = CodeBlock { 5; 1; }
byCoordinateSystemHeightRadius = Cone.ByCoordinateSystemHeightRadius(cs=coordinateSystem, height=code_block_2.out0, startRadius=code_block_2.out1)
code_block_3 = CodeBlock { "0"; }
byGeometry = Autodesk.AutoCAD.DynamoNodes.Object.ByGeometry(geometry=byCoordinateSystemHeightRadius, layer=code_block_3, block=modelSpace)

code_block_4 = CodeBlock(wait_creation=byGeometry, source_blocks=filterByBoolMask.in) { wait_creation; source_blocks; }
delete = Autodesk.AutoCAD.DynamoNodes.Object.Delete(object=code_block_4.source_blocks)
