# Dynamo graph ЦК_М3_Python и Визуальное программирование_Тема-2_Лекция 2.3.dyn (Dynamo 2.13.1.3887)

# group: Формирование списка Текст и МТекст в чертеже
objects_types = AcObjectTypes("Многострочный текст")
current = Autodesk.AutoCAD.DynamoNodes.Document.Current()
modelSpace = Autodesk.AutoCAD.DynamoNodes.Document.ModelSpace(document=current)
all_objects_of_type = AcObjectsOfType(type=objects_types, block=modelSpace)
objects_types_2 = AcObjectTypes("Текст")
all_objects_of_type_2 = AcObjectsOfType(type=objects_types_2, block=modelSpace)
join = List.Join(list0=all_objects_of_type, list1=all_objects_of_type_2)

# group: Изменение угла поворота текстов
code_block = CodeBlock { 0; }
python_script = Python(IN[0]=join, IN[1]=code_block)  # IronPython2
# ---------- python_script.python (49 lines) ----------
# Load the Python Standard and DesignScript Libraries
import sys
import clr

# Add Assemblies for AutoCAD and Civil3D
clr.AddReference('AcMgd')
clr.AddReference('AcCoreMgd')
clr.AddReference('AcDbMgd')
clr.AddReference('AecBaseMgd')
clr.AddReference('AecPropDataMgd')
clr.AddReference('AeccDbMgd')

# Import references from AutoCAD
from Autodesk.AutoCAD.Runtime import *
from Autodesk.AutoCAD.ApplicationServices import *
from Autodesk.AutoCAD.EditorInput import *
from Autodesk.AutoCAD.DatabaseServices import *
from Autodesk.AutoCAD.Geometry import *

# Import references from Civil3D
from Autodesk.Civil.ApplicationServices import *
from Autodesk.Civil.DatabaseServices import *

# The inputs to this node will be stored as a list in the IN variables.
objects_list = IN[0]
to_value_rotate = IN[1]
text_data = list()

adoc = Application.DocumentManager.MdiActiveDocument
editor = adoc.Editor

with adoc.LockDocument():
    with adoc.Database as db:

        with db.TransactionManager.StartTransaction() as t:
            # Place your code below
            for one_object in objects_list:
                item_handle = one_object.Handle
                item_object_id = db.GetObjectId(False, Handle(int(item_handle, 16)), 0)
                item_db_object = t.GetObject(item_object_id, OpenMode.ForWrite)
                if "MText" in str(type(one_object)):
                    item_db_object.Rotation = to_value_rotate
                    text_data.Add(item_db_object.Contents)
                elif "Text" in str(type(one_object)):
                    item_db_object.Rotation = to_value_rotate
                    text_data.Add(item_db_object.TextString)
            t.Commit()
# Assign your output to the OUT variable.
OUT = text_data
# ----------------------------------------
