# Dynamo graph bim_Py_title3_Lection-3.6_Подключение к nanocad_demo.dyn "ЦК_М3_Python и Визуальное программирование_Тема-3_Лекция 3.6 Подключение к nanocad" (Dynamo 2.17.0.3472)
# packages: DynNCAD 2.0.0

application = DynNCAD.App.Application.Application()
caption = DynNCAD.App.Application.Caption(application=application)
document = DynNCAD.App.Document.Document(Application=application)
fullName = DynNCAD.App.Document.FullName(document=document)
python_script = Python(IN[0]=document)  # IronPython2
# ---------- python_script.python (1 lines) ----------
OUT = IN[0]._i.Name
# ----------------------------------------
