# Dynamo graph bim_Py_title3_Lection-3.7_Оформление листов.dyn (Dynamo 2.17.0.3472)
# packages: DynNCAD 2.0.0

application = DynNCAD.App.Application.Application()
document = DynNCAD.App.Document.Document(Application=application)
acadDatabase = DynNCAD.General.AcadDatabase.AcadDatabase(Document=document)
layouts_AsBlocks = DynNCAD.General.AcadDatabase.Layouts_AsBlocks(acadDatabase=acadDatabase)
name = DynNCAD.General.AcadBlock.Name(acadBlock=layouts_AsBlocks)
